% Simulink data dictionary kf_dict.sldd

Af = 1.6
rho_air = 1.206
Cd = 0.3

kf_A = [1 0 0 0 -0.0002958333 0 0 0
 0 1 0 0 0 -0.0002958333 0 0
 0 0 1 0 0 0 -0.0002890291 0
 0 0 0 1 0 0 0 -0.0002890291
 0 0 0 0 1 0 0 0
 0 0 0 0 0 1 0 0
 0 0 0 0 0 0 1 0
 0 0 0 0 0 0 0 1]

kf_B = [0.001 0 0 0
 0 0.001 0 0
 0 0 0.001 0
 0 0 0 0.001
 0 0 0 0
 0 0 0 0
 0 0 0 0
 0 0 0 0]

kf_C = [1 0 0 0 0 0 0 0
 0 1 0 0 0 0 0 0
 0 0 1 0 0 0 0 0
 0 0 0 1 0 0 0 0]

kf_D = repmat(0, 4, 4)

kf_Psi = [-0.2890291 0 0 0 0 0 0 0
 0 -0.2890291 0 0 0 0 0 0
 0 0 -0.2890291 0 0 0 0 0
 0 0 0 -0.2890291 0 0 0 0
 0 0 0 0 2 0 0 0
 0 0 0 0 0 2 0 0
 0 0 0 0 0 0 2 0
 0 0 0 0 0 0 0 2]

kf_L = [1.255293 8.041162e-17 6.004759e-17 -2.821235e-18
 2.002766e-17 1.255293 -1.214592e-17 -4.712801e-16
 7.413932e-17 -1.552854e-17 1.250263 -2.732145e-17
 -7.676618e-18 -2.404836e-16 -1.188967e-17 1.250263
 -862.9638 1.344851e-15 6.455917e-13 -6.97859e-17
 -3.751649e-14 -862.9638 6.874618e-14 1.63655e-12
 5.122959e-13 9.386981e-14 -865.8737 2.823688e-14
 -1.563157e-13 1.110317e-12 6.697945e-13 -865.8737]

CAN_MESSAGE_BUS = Simulink.Bus()
  Extended: uint8
  Length: uint8
  Remote: uint8
  Error: uint8
  ID: uint32
  Timestamp: double
  Data: uint8[8]